# Dynamo graph auto-department-by-room.dyn (Dynamo 3.3.0.6316)

categories = Categories("OST_Rooms")
all_elements_of_category = ElementsOfCategory(Category=categories)
watch = Watch(all_elements_of_category)
code_block = CodeBlock { "Name"; }
getParameterValueByName = Element.GetParameterValueByName(element=all_elements_of_category, parameterName=code_block)
watch_2 = Watch(getParameterValueByName)
python_script = Python(IN[0]=all_elements_of_category, IN[1]=getParameterValueByName)  # CPython3
# ---------- python_script.python (52 lines) ----------
import clr
clr.AddReference('RevitAPI')
from Autodesk.Revit.DB import *
clr.AddReference('RevitServices')
from RevitServices.Persistence import DocumentManager
from RevitServices.Transactions import TransactionManager

doc = DocumentManager.Instance.CurrentDBDocument

rooms = UnwrapElement(IN[0])
names = IN[1]

mapping = {
    "office": "Administration",
    "meeting": "Management",
    "conference": "Management",
    "toilet": "Facility",
    "pantry": "Facility",
    "lobby": "Public",
    "reception": "Public",
    "server": "IT",
    "storage": "Facility",
    "corridor": "Circulation",
    "stair": "Circulation"
}

result_log = []

TransactionManager.Instance.EnsureInTransaction(doc)

for room, name in zip(rooms, names):
    if name is None:
        continue
    name_lower = name.lower()
    matched_dept = None
    for keyword, department in mapping.items():
        if keyword in name_lower:
            matched_dept = department
            break
    if matched_dept:
        param = room.get_Parameter(BuiltInParameter.ROOM_DEPARTMENT)
        if param and not param.IsReadOnly:
            param.Set(matched_dept)
            result_log.append("OK: " + name + " -> " + matched_dept)
        else:
            result_log.append("LOCKED: " + name)
    else:
        result_log.append("NO MATCH: " + name)

TransactionManager.Instance.TransactionTaskDone()

OUT = result_log
# ----------------------------------------
watch_3 = Watch(python_script)
