# Dynamo graph auto-finish-properties.dyn "Ngasal" (Dynamo 3.3.0.6316)

code_block = CodeBlock { "Wall Finish"; }
python_script = Python(IN[0]=code_block)  # CPython3
# ---------- python_script.python (258 lines) ----------
import clr
import math

clr.AddReference('RevitAPI')
from Autodesk.Revit.DB import *
from Autodesk.Revit.DB.Architecture import Room

clr.AddReference('RevitServices')
from RevitServices.Persistence import DocumentManager
from RevitServices.Transactions import TransactionManager

doc = DocumentManager.Instance.CurrentDBDocument

target_param_name = IN[0] if IN[0] else "Comments"

# =====================================
# HELPERS
# =====================================
def get_room_point(room):
    try:
        loc = room.Location
        if loc and hasattr(loc, "Point"):
            return loc.Point
    except:
        pass
    return None

def get_material_name(mat_id):
    try:
        if mat_id and mat_id != ElementId.InvalidElementId:
            mat = doc.GetElement(mat_id)
            if mat and mat.Name:
                return mat.Name
    except:
        pass
    return None

def normalize_xyz(v):
    try:
        l = math.sqrt(v.X*v.X + v.Y*v.Y + v.Z*v.Z)
        if l == 0:
            return None
        return XYZ(v.X/l, v.Y/l, v.Z/l)
    except:
        return None

def dot_xyz(a, b):
    return a.X*b.X + a.Y*b.Y + a.Z*b.Z

def get_wall_midpoint(wall):
    try:
        c = wall.Location.Curve
        return c.Evaluate(0.5, True)
    except:
        try:
            c = wall.Curve
            return c.Evaluate(0.5, True)
        except:
            return None

def get_room_facing_side(wall, room_point):
    """
    Tentukan room berada di sisi Interior atau Exterior wall.
    Wall.Orientation dianggap mengarah ke sisi exterior wall.
    Jika vektor dari midpoint wall ke titik room searah orientation,
    berarti room ada di sisi exterior.
    Kalau berlawanan, room ada di sisi interior.
    """
    try:
        wall_mid = get_wall_midpoint(wall)
        if wall_mid is None or room_point is None:
            return None

        orient = normalize_xyz(wall.Orientation)
        if orient is None:
            return None

        vec_to_room = XYZ(
            room_point.X - wall_mid.X,
            room_point.Y - wall_mid.Y,
            0
        )
        vec_to_room = normalize_xyz(vec_to_room)
        if vec_to_room is None:
            return None

        d = dot_xyz(orient, vec_to_room)

        if d >= 0:
            return ShellLayerType.Exterior
        else:
            return ShellLayerType.Interior
    except:
        return None

def get_finish_material_from_room_side(wall, room_point):
    """
    Ambil material dari shell layer sisi wall yang menghadap room.
    Prioritas:
    1. shell side yang menghadap room
    2. ambil layer shell terluar pada sisi tersebut
    """
    try:
        wt = doc.GetElement(wall.GetTypeId())
        if wt is None:
            return None

        cs = wt.GetCompoundStructure()
        if cs is None:
            return None

        layers = list(cs.GetLayers())
        if not layers or len(layers) == 0:
            return None

        room_side = get_room_facing_side(wall, room_point)
        if room_side is None:
            return None

        ext_count = 0
        int_count = 0

        try:
            ext_count = cs.GetNumberOfShellLayers(ShellLayerType.Exterior)
        except:
            ext_count = 0

        try:
            int_count = cs.GetNumberOfShellLayers(ShellLayerType.Interior)
        except:
            int_count = 0

        # Jika room menghadap sisi exterior, ambil shell exterior terluar
        if room_side == ShellLayerType.Exterior:
            if ext_count > 0:
                for i in range(ext_count):
                    name = get_material_name(layers[i].MaterialId)
                    if name:
                        return name

        # Jika room menghadap sisi interior, ambil shell interior terluar
        elif room_side == ShellLayerType.Interior:
            if int_count > 0:
                start_index = len(layers) - int_count
                for i in range(start_index, len(layers)):
                    name = get_material_name(layers[i].MaterialId)
                    if name:
                        return name

        # fallback: cari material pertama saja
        for layer in layers:
            name = get_material_name(layer.MaterialId)
            if name:
                return name

    except:
        pass

    return None

def get_boundary_walls(room):
    walls = []
    try:
        opts = SpatialElementBoundaryOptions()
        loops = room.GetBoundarySegments(opts)

        if loops:
            for loop in loops:
                for seg in loop:
                    elem_id = seg.ElementId
                    if elem_id and elem_id != ElementId.InvalidElementId:
                        elem = doc.GetElement(elem_id)
                        if isinstance(elem, Wall):
                            if elem.Id.IntegerValue not in [w.Id.IntegerValue for w in walls]:
                                walls.append(elem)
    except:
        pass
    return walls

def set_room_text_parameter(room, param_name, value):
    try:
        p = room.LookupParameter(param_name)
        if p and not p.IsReadOnly and p.StorageType == StorageType.String:
            p.Set(value)
            return True
    except:
        pass
    return False

# =====================================
# COLLECT ROOMS
# =====================================
rooms = FilteredElementCollector(doc) \
    .OfCategory(BuiltInCategory.OST_Rooms) \
    .WhereElementIsNotElementType() \
    .ToElements()

processed = []
skipped = []
failed = []

TransactionManager.Instance.EnsureInTransaction(doc)

for room in rooms:
    try:
        try:
            if room.Area <= 0:
                skipped.append("Room {} skipped (area=0)".format(room.Id.IntegerValue))
                continue
        except:
            pass

        room_point = get_room_point(room)
        if room_point is None:
            failed.append("Room {}: no room location point".format(room.Id.IntegerValue))
            continue

        boundary_walls = get_boundary_walls(room)
        if not boundary_walls:
            failed.append("Room {}: no boundary walls found".format(room.Id.IntegerValue))
            continue

        finish_names = []

        for wall in boundary_walls:
            mat_name = get_finish_material_from_room_side(wall, room_point)
            if mat_name and mat_name not in finish_names:
                finish_names.append(mat_name)

        if not finish_names:
            failed.append("Room {}: no room-side wall finish found".format(room.Id.IntegerValue))
            continue

        finish_text = ", ".join(finish_names)

        ok = set_room_text_parameter(room, target_param_name, finish_text)

        room_name = ""
        try:
            room_name = room.LookupParameter("Name").AsString()
        except:
            room_name = ""

        if ok:
            processed.append("Room {} [{}] -> {}".format(
                room.Id.IntegerValue, room_name, finish_text
            ))
        else:
            failed.append("Room {}: parameter '{}' not writable/text".format(
                room.Id.IntegerValue, target_param_name
            ))

    except Exception as e:
        failed.append("Room {}: {}".format(room.Id.IntegerValue, str(e)))

TransactionManager.Instance.TransactionTaskDone()

OUT = processed, skipped, failedOUT = processed, skipped, failedOUT = processed, skipped, failed
# ----------------------------------------
code_block_2 = CodeBlock { "Floor Finish"; }
python_script_2 = Python(IN[0]=code_block_2)  # CPython3
# ---------- python_script_2.python (232 lines) ----------
import clr

clr.AddReference('RevitAPI')
from Autodesk.Revit.DB import *
from Autodesk.Revit.DB.Architecture import Room

clr.AddReference('RevitServices')
from RevitServices.Persistence import DocumentManager
from RevitServices.Transactions import TransactionManager

doc = DocumentManager.Instance.CurrentDBDocument

target_param_name = IN[0] if IN[0] else "Comments"

# =====================================
# HELPERS
# =====================================
def get_room_point(room):
    try:
        loc = room.Location
        if loc and hasattr(loc, "Point"):
            return loc.Point
    except:
        pass
    return None

def get_room_level_elevation(room):
    try:
        lvl = doc.GetElement(room.LevelId)
        if lvl:
            return lvl.Elevation
    except:
        pass
    return None

def get_material_name(mat_id):
    try:
        if mat_id and mat_id != ElementId.InvalidElementId:
            mat = doc.GetElement(mat_id)
            if mat and mat.Name:
                return mat.Name
    except:
        pass
    return None

def point_inside_bbox_xy(point, bbox, tol=0.5):
    if point is None or bbox is None:
        return False
    return (
        bbox.Min.X - tol <= point.X <= bbox.Max.X + tol and
        bbox.Min.Y - tol <= point.Y <= bbox.Max.Y + tol
    )

def get_floor_reference_z(floor):
    # pakai level + height above level jika ada
    try:
        lvl = doc.GetElement(floor.LevelId)
        lvl_z = lvl.Elevation if lvl else 0.0

        p = floor.get_Parameter(BuiltInParameter.FLOOR_HEIGHTABOVELEVEL_PARAM)
        h = p.AsDouble() if p and p.HasValue else 0.0

        return lvl_z + h
    except:
        pass

    # fallback bbox
    try:
        bbox = floor.get_BoundingBox(None)
        if bbox:
            return bbox.Max.Z
    except:
        pass

    return None

def get_top_finish_material_name(floor):
    """
    Ambil material finish sisi atas floor.
    Prioritas:
    1. shell layer sisi Exterior (umumnya sisi atas floor)
    2. fallback layer awal yang punya material
    3. fallback material ids
    """
    try:
        ft = doc.GetElement(floor.GetTypeId())
        if ft is None:
            return None

        cs = ft.GetCompoundStructure()
        if cs is None:
            return None

        layers = list(cs.GetLayers())
        if not layers or len(layers) == 0:
            return None

        # coba shell layer sisi atas / exterior
        try:
            ext_count = cs.GetNumberOfShellLayers(ShellLayerType.Exterior)
        except:
            ext_count = 0

        if ext_count > 0:
            for i in range(ext_count):
                mat_name = get_material_name(layers[i].MaterialId)
                if mat_name:
                    return mat_name

        # fallback: ambil layer pertama yang punya material
        for layer in layers:
            mat_name = get_material_name(layer.MaterialId)
            if mat_name:
                return mat_name

    except:
        pass

    # fallback terakhir
    try:
        mat_ids = floor.GetMaterialIds(False)
        if mat_ids and mat_ids.Count > 0:
            for mat_id in mat_ids:
                mat_name = get_material_name(mat_id)
                if mat_name:
                    return mat_name
    except:
        pass

    return None

def get_best_floor_for_room(room, floors):
    room_pt = get_room_point(room)
    room_lvl_z = get_room_level_elevation(room)

    if room_pt is None:
        return None, "No room point"

    candidates = []

    for floor in floors:
        try:
            bbox = floor.get_BoundingBox(None)
            if bbox is None:
                continue

            if not point_inside_bbox_xy(room_pt, bbox, tol=1.0):
                continue

            floor_z = get_floor_reference_z(floor)
            if floor_z is None:
                continue

            # cari yang paling dekat dengan level room
            dz = abs(floor_z - room_lvl_z) if room_lvl_z is not None else 999999
            candidates.append((dz, floor))
        except:
            pass

    if not candidates:
        return None, "No candidate floor"

    candidates.sort(key=lambda x: x[0])
    return candidates[0][1], "OK"

def set_room_text_parameter(room, param_name, value):
    try:
        p = room.LookupParameter(param_name)
        if not p:
            return False, "Parameter not found"
        if p.IsReadOnly:
            return False, "Parameter read-only"
        if p.StorageType != StorageType.String:
            return False, "Parameter not text"
        p.Set(value)
        return True, "OK"
    except Exception as e:
        return False, str(e)

# =====================================
# COLLECT
# =====================================
rooms = FilteredElementCollector(doc) \
    .OfCategory(BuiltInCategory.OST_Rooms) \
    .WhereElementIsNotElementType() \
    .ToElements()

floors = FilteredElementCollector(doc) \
    .OfClass(Floor) \
    .WhereElementIsNotElementType() \
    .ToElements()

processed = []
skipped = []
failed = []

TransactionManager.Instance.EnsureInTransaction(doc)

for room in rooms:
    try:
        if room.Area <= 0:
            skipped.append("Room {} skipped (area=0)".format(room.Id.IntegerValue))
            continue

        room_name = ""
        try:
            room_name = room.LookupParameter("Name").AsString()
        except:
            room_name = ""

        floor, status = get_best_floor_for_room(room, floors)
        if floor is None:
            failed.append("Room {} [{}]: {}".format(room.Id.IntegerValue, room_name, status))
            continue

        mat_name = get_top_finish_material_name(floor)
        if not mat_name:
            failed.append("Room {} [{}]: no top finish material found".format(room.Id.IntegerValue, room_name))
            continue

        ok, msg = set_room_text_parameter(room, target_param_name, mat_name)
        if ok:
            processed.append("Room {} [{}] -> {}".format(room.Id.IntegerValue, room_name, mat_name))
        else:
            failed.append("Room {} [{}]: {}".format(room.Id.IntegerValue, room_name, msg))

    except Exception as e:
        failed.append("Room {}: {}".format(room.Id.IntegerValue, str(e)))

TransactionManager.Instance.TransactionTaskDone()

OUT = processed, skipped, failed
# ----------------------------------------
code_block_3 = CodeBlock { "Ceiling Finish"; }
python_script_3 = Python(IN[0]=code_block_3)  # CPython3
# ---------- python_script_3.python (258 lines) ----------
import clr

clr.AddReference('RevitAPI')
from Autodesk.Revit.DB import *
from Autodesk.Revit.DB.Architecture import Room

clr.AddReference('RevitServices')
from RevitServices.Persistence import DocumentManager
from RevitServices.Transactions import TransactionManager

doc = DocumentManager.Instance.CurrentDBDocument

target_param_name = IN[0] if IN[0] else "Comments"

# =====================================
# HELPERS
# =====================================
def get_room_point(room):
    try:
        loc = room.Location
        if loc and hasattr(loc, "Point"):
            return loc.Point
    except:
        pass
    return None

def get_room_upper_z(room):
    """
    Ambil elevasi atas room.
    Prioritas:
    1. base level + Unbounded Height
    2. room point Z + default
    """
    try:
        lvl = doc.GetElement(room.LevelId)
        base_z = lvl.Elevation if lvl else 0.0

        p = room.get_Parameter(BuiltInParameter.ROOM_UPPER_OFFSET)
        upper_offset = p.AsDouble() if p and p.HasValue else None

        p2 = room.get_Parameter(BuiltInParameter.ROOM_HEIGHT)
        room_height = p2.AsDouble() if p2 and p2.HasValue else None

        if room_height is not None:
            return base_z + room_height
        elif upper_offset is not None:
            return base_z + upper_offset
    except:
        pass

    pt = get_room_point(room)
    if pt:
        return pt.Z + 10.0

    return None

def get_material_name(mat_id):
    try:
        if mat_id and mat_id != ElementId.InvalidElementId:
            mat = doc.GetElement(mat_id)
            if mat and mat.Name:
                return mat.Name
    except:
        pass
    return None

def point_inside_bbox_xy(point, bbox, tol=0.5):
    if point is None or bbox is None:
        return False
    return (
        bbox.Min.X - tol <= point.X <= bbox.Max.X + tol and
        bbox.Min.Y - tol <= point.Y <= bbox.Max.Y + tol
    )

def get_ceiling_reference_z(ceiling):
    """
    Ambil elevasi referensi ceiling.
    Prioritas:
    1. level elevation + height above level
    2. bbox min z
    """
    try:
        lvl = doc.GetElement(ceiling.LevelId)
        lvl_z = lvl.Elevation if lvl else 0.0

        p = ceiling.get_Parameter(BuiltInParameter.CEILING_HEIGHTABOVELEVEL_PARAM)
        h = p.AsDouble() if p and p.HasValue else 0.0

        return lvl_z + h
    except:
        pass

    try:
        bbox = ceiling.get_BoundingBox(None)
        if bbox:
            return bbox.Min.Z
    except:
        pass

    return None

def get_bottom_finish_material_name(ceiling):
    """
    Ambil material sisi bawah ceiling.
    Prioritas:
    1. shell layer sisi interior
    2. fallback layer terakhir yang punya material
    3. fallback material ids
    """
    try:
        ct = doc.GetElement(ceiling.GetTypeId())
        if ct is None:
            return None

        cs = ct.GetCompoundStructure()
        if cs is None:
            return None

        layers = list(cs.GetLayers())
        if not layers or len(layers) == 0:
            return None

        # Untuk ceiling, sisi bawah yang menghadap room biasanya sisi interior
        try:
            int_count = cs.GetNumberOfShellLayers(ShellLayerType.Interior)
        except:
            int_count = 0

        if int_count > 0:
            start_index = len(layers) - int_count
            for i in range(start_index, len(layers)):
                mat_name = get_material_name(layers[i].MaterialId)
                if mat_name:
                    return mat_name

        # fallback: ambil layer terakhir yang punya material
        for i in range(len(layers) - 1, -1, -1):
            mat_name = get_material_name(layers[i].MaterialId)
            if mat_name:
                return mat_name

    except:
        pass

    # fallback terakhir
    try:
        mat_ids = ceiling.GetMaterialIds(False)
        if mat_ids and mat_ids.Count > 0:
            for mat_id in mat_ids:
                mat_name = get_material_name(mat_id)
                if mat_name:
                    return mat_name
    except:
        pass

    return None

def get_best_ceiling_for_room(room, ceilings):
    room_pt = get_room_point(room)
    room_top_z = get_room_upper_z(room)

    if room_pt is None:
        return None, "No room point"

    candidates = []

    for ceiling in ceilings:
        try:
            bbox = ceiling.get_BoundingBox(None)
            if bbox is None:
                continue

            if not point_inside_bbox_xy(room_pt, bbox, tol=1.0):
                continue

            ceil_z = get_ceiling_reference_z(ceiling)
            if ceil_z is None:
                continue

            # ceiling harus di atas atau dekat atas room
            dz = abs(ceil_z - room_top_z) if room_top_z is not None else 999999
            candidates.append((dz, ceil_z, ceiling))
        except:
            pass

    if not candidates:
        return None, "No candidate ceiling"

    candidates.sort(key=lambda x: x[0])
    return candidates[0][2], "OK"

def set_room_text_parameter(room, param_name, value):
    try:
        p = room.LookupParameter(param_name)
        if not p:
            return False, "Parameter not found"
        if p.IsReadOnly:
            return False, "Parameter read-only"
        if p.StorageType != StorageType.String:
            return False, "Parameter not text"
        p.Set(value)
        return True, "OK"
    except Exception as e:
        return False, str(e)

# =====================================
# COLLECT
# =====================================
rooms = FilteredElementCollector(doc) \
    .OfCategory(BuiltInCategory.OST_Rooms) \
    .WhereElementIsNotElementType() \
    .ToElements()

ceilings = FilteredElementCollector(doc) \
    .OfCategory(BuiltInCategory.OST_Ceilings) \
    .WhereElementIsNotElementType() \
    .ToElements()

processed = []
skipped = []
failed = []

TransactionManager.Instance.EnsureInTransaction(doc)

for room in rooms:
    try:
        if room.Area <= 0:
            skipped.append("Room {} skipped (area=0)".format(room.Id.IntegerValue))
            continue

        room_name = ""
        try:
            room_name = room.LookupParameter("Name").AsString()
        except:
            room_name = ""

        ceiling, status = get_best_ceiling_for_room(room, ceilings)
        if ceiling is None:
            failed.append("Room {} [{}]: {}".format(room.Id.IntegerValue, room_name, status))
            continue

        mat_name = get_bottom_finish_material_name(ceiling)
        if not mat_name:
            failed.append("Room {} [{}]: no ceiling finish material found".format(room.Id.IntegerValue, room_name))
            continue

        ok, msg = set_room_text_parameter(room, target_param_name, mat_name)
        if ok:
            processed.append("Room {} [{}] -> {}".format(room.Id.IntegerValue, room_name, mat_name))
        else:
            failed.append("Room {} [{}]: {}".format(room.Id.IntegerValue, room_name, msg))

    except Exception as e:
        failed.append("Room {}: {}".format(room.Id.IntegerValue, str(e)))

TransactionManager.Instance.TransactionTaskDone()

OUT = processed, skipped, failed
# ----------------------------------------
