# Dynamo graph auto-floors-by-rooms.dyn (Dynamo 3.3.0.6316)

categories = Categories("OST_Rooms")
all_elements_of_category = ElementsOfCategory(Category=categories)
floor_types = FloorTypes("Standard Timber-Wood Finish")  # graph input
offset = DoubleInput(0)  # graph input
structural = BoolSelector(false)  # graph input
python_script = Python(IN[0]=all_elements_of_category, IN[1]=floor_types, IN[2]=offset, IN[3]=structural)  # CPython3
# ---------- python_script.python (155 lines) ----------
import clr

clr.AddReference('RevitAPI')
from Autodesk.Revit.DB import *
from Autodesk.Revit.DB.Architecture import Room

clr.AddReference('RevitServices')
from RevitServices.Persistence import DocumentManager
from RevitServices.Transactions import TransactionManager

doc = DocumentManager.Instance.CurrentDBDocument

# =========================
# INPUT
# =========================
rooms_input = IN[0]
floor_type = UnwrapElement(IN[1])
offset = IN[2] if IN[2] else 0.0
is_structural = IN[3] if IN[3] is not None else False

# Pastikan input room menjadi list
if not isinstance(rooms_input, list):
    rooms = [UnwrapElement(rooms_input)]
else:
    rooms = [UnwrapElement(r) for r in rooms_input]

# =========================
# HELPER
# =========================
def get_room_boundary_loops(room):
    """
    Mengambil boundary room dan mengubahnya menjadi list of CurveLoop.
    Satu room bisa punya lebih dari satu loop.
    """
    opts = SpatialElementBoundaryOptions()
    segments_lists = room.GetBoundarySegments(opts)

    if not segments_lists:
        return None

    curve_loops = []

    for seg_list in segments_lists:
        curve_loop = CurveLoop()
        has_curve = False

        for seg in seg_list:
            c = seg.GetCurve()
            if c:
                curve_loop.Append(c)
                has_curve = True

        if has_curve:
            curve_loops.append(curve_loop)

    return curve_loops if curve_loops else None


def set_floor_offset(floor, offset_value):
    """
    Set parameter height above level jika tersedia.
    """
    p = floor.get_Parameter(BuiltInParameter.FLOOR_HEIGHTABOVELEVEL_PARAM)
    if p and not p.IsReadOnly:
        p.Set(offset_value)


def valid_room(room):
    """
    Cek room valid:
    - objek ada
    - area > 0
    - punya level
    """
    if room is None:
        return False, "Room is None"

    try:
        if room.Area <= 0:
            return False, "Room area <= 0"
    except:
        return False, "Cannot read room area"

    try:
        lvl_id = room.LevelId
        if lvl_id == ElementId.InvalidElementId:
            return False, "Invalid LevelId"
    except:
        return False, "Cannot read room level"

    return True, ""


# =========================
# MAIN
# =========================
created_floors = []
failed_rooms = []
log = []

if floor_type is None:
    OUT = ([], ["FloorType input is null"], ["No floor created"])
else:
    TransactionManager.Instance.EnsureInTransaction(doc)

    for room in rooms:
        try:
            ok, msg = valid_room(room)
            if not ok:
                failed_rooms.append(room)
                log.append("FAILED - Room [{}]: {}".format(room.Id.IntegerValue if room else "None", msg))
                continue

            loops = get_room_boundary_loops(room)
            if not loops:
                failed_rooms.append(room)
                log.append("FAILED - Room [{}]: No valid boundary loops".format(room.Id.IntegerValue))
                continue

            level_id = room.LevelId

            # Membuat floor dari boundary room
            new_floor = Floor.Create(
                doc,
                loops,
                floor_type.Id,
                level_id,
                is_structural,
                None,
                0.0
            )

            # Set offset setelah floor dibuat
            if new_floor:
                set_floor_offset(new_floor, offset)
                created_floors.append(new_floor)
                log.append("SUCCESS - Room [{}] -> Floor [{}]".format(
                    room.Id.IntegerValue,
                    new_floor.Id.IntegerValue
                ))
            else:
                failed_rooms.append(room)
                log.append("FAILED - Room [{}]: Floor.Create returned null".format(room.Id.IntegerValue))

        except Exception as e:
            failed_rooms.append(room)
            try:
                rid = room.Id.IntegerValue
            except:
                rid = "Unknown"
            log.append("FAILED - Room [{}]: {}".format(rid, str(e)))

    TransactionManager.Instance.TransactionTaskDone()

    OUT = (created_floors, failed_rooms, log)
# ----------------------------------------
