# Dynamo graph auto-level.dyn (Dynamo 3.3.0.6316)

floor_to_floor = DoubleInput(4)  # graph input
jumlah_lantai = DoubleInput(5)  # graph input
python_script = Python(IN[0]=floor_to_floor, IN[1]=jumlah_lantai)  # CPython3
# ---------- python_script.python (44 lines) ----------
import clr

clr.AddReference('RevitAPI')
from Autodesk.Revit.DB import *

clr.AddReference('RevitServices')
from RevitServices.Persistence import DocumentManager
from RevitServices.Transactions import TransactionManager

doc = DocumentManager.Instance.CurrentDBDocument

# =========================
# INPUT
# IN[0] = floor to floor (meter)
# IN[1] = jumlah lantai
# =========================
floor_to_floor = IN[0] if IN[0] is not None else 4.0
floor_count = IN[1] if IN[1] is not None else 5

floor_to_floor = float(floor_to_floor)
floor_count = int(floor_count)

def m_to_ft(m):
    return float(m) / 0.3048

floor_to_floor_ft = m_to_ft(floor_to_floor)

created_levels = []
failed = []

TransactionManager.Instance.EnsureInTransaction(doc)

for i in range(floor_count):
    try:
        elev_ft = i * floor_to_floor_ft
        level = Level.Create(doc, elev_ft)
        level.Name = "Lantai {}".format(i + 1)
        created_levels.append(level)
    except Exception as e:
        failed.append("Lantai {} gagal: {}".format(i + 1, str(e)))

TransactionManager.Instance.TransactionTaskDone()

OUT = created_levels, failed
# ----------------------------------------
