# Dynamo graph auto-dimension.dyn (Dynamo 3.3.0.6316)

number = DoubleInput(-500)
number_2 = DoubleInput(-500)
python_script = Python(IN[0]=number, IN[1]=number_2)  # CPython3
# ---------- python_script.python (155 lines) ----------
import clr

clr.AddReference('RevitAPI')
from Autodesk.Revit.DB import *

clr.AddReference('RevitServices')
from RevitServices.Persistence import DocumentManager
from RevitServices.Transactions import TransactionManager

doc = DocumentManager.Instance.CurrentDBDocument
view = doc.ActiveView

# =========================
# INPUT
# =========================
offset_bottom_mm = IN[0] if IN[0] is not None else 2000
offset_left_mm   = IN[1] if IN[1] is not None else 2000

def mm_to_ft(mm):
    return float(mm) / 304.8

offset_bottom = mm_to_ft(offset_bottom_mm)
offset_left   = mm_to_ft(offset_left_mm)

# =========================
# COLLECT STRAIGHT GRIDS
# =========================
all_grids = FilteredElementCollector(doc, view.Id)\
    .OfClass(Grid)\
    .WhereElementIsNotElementType()\
    .ToElements()

straight_grids = []
for g in all_grids:
    try:
        c = g.Curve
        if isinstance(c, Line):
            straight_grids.append(g)
    except:
        pass

# =========================
# SPLIT VERTICAL / HORIZONTAL
# vertical grid   = line direction mostly Y
# horizontal grid = line direction mostly X
# =========================
vertical_grids = []
horizontal_grids = []

for g in straight_grids:
    line = g.Curve
    d = line.Direction

    if abs(d.Y) > abs(d.X):
        vertical_grids.append(g)
    else:
        horizontal_grids.append(g)

# =========================
# HELPERS
# =========================
def get_endpoints(grid):
    c = grid.Curve
    return c.GetEndPoint(0), c.GetEndPoint(1)

def grid_mid_x(grid):
    p1, p2 = get_endpoints(grid)
    return (p1.X + p2.X) / 2.0

def grid_mid_y(grid):
    p1, p2 = get_endpoints(grid)
    return (p1.Y + p2.Y) / 2.0

def make_reference_array(grids):
    ra = ReferenceArray()
    for g in grids:
        ra.Append(Reference(g))
    return ra

# urutkan grid
vertical_grids = sorted(vertical_grids, key=lambda g: grid_mid_x(g))
horizontal_grids = sorted(horizontal_grids, key=lambda g: grid_mid_y(g))

created_dims = []
messages = []

TransactionManager.Instance.EnsureInTransaction(doc)

# =========================
# DIMENSION FOR VERTICAL GRIDS
# placed at the very bottom
# =========================
try:
    if len(vertical_grids) >= 2:
        x_vals = []
        y_vals = []

        for g in vertical_grids:
            p1, p2 = get_endpoints(g)
            x_vals.append((p1.X + p2.X) / 2.0)
            y_vals.extend([p1.Y, p2.Y])

        x_min = min(x_vals)
        x_max = max(x_vals)
        y_bottom = min(y_vals) - offset_bottom

        dim_line = Line.CreateBound(
            XYZ(x_min, y_bottom, 0),
            XYZ(x_max, y_bottom, 0)
        )

        ref_array = make_reference_array(vertical_grids)
        dim = doc.Create.NewDimension(view, dim_line, ref_array)
        created_dims.append(dim)
        messages.append("Dimensi grid vertikal dibuat di paling bawah.")
    else:
        messages.append("Grid vertikal kurang dari 2.")
except Exception as e:
    messages.append("Gagal membuat dimensi grid vertikal: {}".format(str(e)))

# =========================
# DIMENSION FOR HORIZONTAL GRIDS
# placed at the very left
# =========================
try:
    if len(horizontal_grids) >= 2:
        x_vals = []
        y_vals = []

        for g in horizontal_grids:
            p1, p2 = get_endpoints(g)
            x_vals.extend([p1.X, p2.X])
            y_vals.append((p1.Y + p2.Y) / 2.0)

        x_left = min(x_vals) - offset_left
        y_min = min(y_vals)
        y_max = max(y_vals)

        dim_line = Line.CreateBound(
            XYZ(x_left, y_min, 0),
            XYZ(x_left, y_max, 0)
        )

        ref_array = make_reference_array(horizontal_grids)
        dim = doc.Create.NewDimension(view, dim_line, ref_array)
        created_dims.append(dim)
        messages.append("Dimensi grid horizontal dibuat di paling kiri.")
    else:
        messages.append("Grid horizontal kurang dari 2.")
except Exception as e:
    messages.append("Gagal membuat dimensi grid horizontal: {}".format(str(e)))

TransactionManager.Instance.TransactionTaskDone()

OUT = created_dims, messages
# ----------------------------------------
