# Dynamo graph auto-grid.dyn (Dynamo 3.3.0.6316)

total_panjang = DoubleInput(48)  # graph input
jarak = DoubleInput(8)  # graph input
bubble_offset = DoubleInput(4)  # graph input
python_script = Python(IN[0]=total_panjang, IN[1]=total_panjang, IN[2]=jarak, IN[3]=jarak, IN[4]=bubble_offset)  # CPython3
# ---------- python_script.python (67 lines) ----------
import clr

clr.AddReference('RevitAPI')
from Autodesk.Revit.DB import *

clr.AddReference('RevitServices')
from RevitServices.Persistence import DocumentManager
from RevitServices.Transactions import TransactionManager

doc = DocumentManager.Instance.CurrentDBDocument

# Input
length_x = IN[0]
length_y = IN[1]
spacing_x = IN[2]
spacing_y = IN[3]
bubble_offset = IN[4] if len(IN) > 4 and IN[4] is not None else 1.0  # meter

# Konversi meter ke feet
def m_to_ft(m):
    return float(m) / 0.3048

length_x_ft = m_to_ft(length_x)
length_y_ft = m_to_ft(length_y)
spacing_x_ft = m_to_ft(spacing_x)
spacing_y_ft = m_to_ft(spacing_y)
bubble_offset_ft = m_to_ft(bubble_offset)

# Buat daftar posisi grid
def generate_positions(total_length, spacing):
    positions = []
    current = 0.0
    while current <= total_length + 0.0001:
        positions.append(current)
        current += spacing
    return positions

x_positions = generate_positions(length_x_ft, spacing_x_ft)
y_positions = generate_positions(length_y_ft, spacing_y_ft)

created_grids = []

TransactionManager.Instance.EnsureInTransaction(doc)

# Grid vertikal (nama angka)
for i, x in enumerate(x_positions):
    line = Line.CreateBound(
        XYZ(x, -bubble_offset_ft, 0),
        XYZ(x, length_y_ft + bubble_offset_ft, 0)
    )
    grid = Grid.Create(doc, line)
    grid.Name = str(i + 1)
    created_grids.append(grid)

# Grid horizontal (nama huruf)
for i, y in enumerate(y_positions):
    line = Line.CreateBound(
        XYZ(-bubble_offset_ft, y, 0),
        XYZ(length_x_ft + bubble_offset_ft, y, 0)
    )
    grid = Grid.Create(doc, line)
    grid.Name = chr(65 + i)  # A, B, C, ...
    created_grids.append(grid)

TransactionManager.Instance.TransactionTaskDone()

OUT = created_grids
# ----------------------------------------
