# Dynamo graph auto-levels-from-code-block.dyn (Dynamo 3.3.0.6316)

code_block = CodeBlock { n = 1..20; }
code_block_2 = CodeBlock(n=code_block) { elevs = (n-1)*4000; }
code_block_3 = CodeBlock(n=code_block) { names = "Lantai" + n; }
byElevationAndName = Level.ByElevationAndName(elevation=code_block_2, name=code_block_3)
