# Dynamo graph auto-levels-from-excel.dyn "levels" (Dynamo 3.3.0.6316)

file_path = Filename(".\levels.xlsx")
file_from_path = FileObject(path=file_path)
code_block = CodeBlock { "levels"; }
importExcel = Data.ImportExcel(file=file_from_path, sheetName=code_block)
code_block_2 = CodeBlock { 0; }
removeItemAtIndex = List.RemoveItemAtIndex(list=importExcel, indices=code_block_2)
transpose = List.Transpose(lists=removeItemAtIndex)
code_block_3 = CodeBlock(level_elevation=transpose) { level_elevation[1]; }
convert_by_units = DynamoUnitConvert(code_block_3, MeasurementType="autodesk.unit.quantity:length-1.0.4", FromConversion="autodesk.unit.unit:meters-1.0.0", ToConversion="autodesk.unit.unit:millimeters-1.0.1")
byElevation = Level.ByElevation(elevation=convert_by_units)
code_block_4 = CodeBlock { "Name"; }
code_block_5 = CodeBlock(level_name=transpose) { level_name[0]; }
setParameterByName = Element.SetParameterByName(element=byElevation, parameterName=code_block_4, value=code_block_5)
byLevel = FloorPlanView.ByLevel(level=setParameterByName)
