# Dynamo graph auto-tag-doors.dyn "asal" (Dynamo 3.3.0.6316)

boolean = BoolSelector(true)  # graph input
python_script = Python(IN[0]=boolean)  # CPython3; graph output
# ---------- python_script.python (169 lines) ----------
# IN[0] = run trigger (boolean)

import clr

clr.AddReference('RevitAPI')
from Autodesk.Revit.DB import *

clr.AddReference('RevitServices')
from RevitServices.Persistence import DocumentManager
from RevitServices.Transactions import TransactionManager

doc = DocumentManager.Instance.CurrentDBDocument
view = doc.ActiveView
runIt = IN[0]

def get_door_center(door, view):
    bbox = door.get_BoundingBox(view)
    if bbox:
        return XYZ(
            (bbox.Min.X + bbox.Max.X) / 2.0,
            (bbox.Min.Y + bbox.Max.Y) / 2.0,
            (bbox.Min.Z + bbox.Max.Z) / 2.0
        )

    loc = door.Location
    if isinstance(loc, LocationPoint):
        return loc.Point

    if isinstance(loc, LocationCurve):
        return loc.Curve.Evaluate(0.5, True)

    return None

def get_existing_tagged_door_ids(doc, view):
    tagged_ids = set()

    tags = FilteredElementCollector(doc, view.Id) \
        .OfClass(IndependentTag) \
        .ToElements()

    for tag in tags:
        try:
            # hanya proses door tag
            if tag.Category is None:
                continue
            if tag.Category.Id.IntegerValue != int(BuiltInCategory.OST_DoorTags):
                continue

            # Revit version bisa beda-beda, jadi dicoba beberapa cara
            try:
                ids = tag.GetTaggedLocalElementIds()
                if ids:
                    for eid in ids:
                        tagged_ids.add(eid.IntegerValue)
                    continue
            except:
                pass

            try:
                eid = tag.TaggedLocalElementId
                if eid and eid.IntegerValue > 0:
                    tagged_ids.add(eid.IntegerValue)
                    continue
            except:
                pass

            try:
                ref = tag.GetTaggedReference()
                if ref and ref.ElementId.IntegerValue > 0:
                    tagged_ids.add(ref.ElementId.IntegerValue)
                    continue
            except:
                pass

        except:
            pass

    return tagged_ids

if not runIt:
    OUT = "Set Boolean ke True untuk menjalankan script.", [], [], []
else:
    invalid_view_types = [
        ViewType.ThreeD,
        ViewType.Schedule,
        ViewType.DrawingSheet,
        ViewType.ProjectBrowser,
        ViewType.SystemBrowser,
        ViewType.Report,
        ViewType.CostReport,
        ViewType.LoadsReport,
        ViewType.PresureLossReport,
        ViewType.ColumnSchedule,
        ViewType.PanelSchedule
    ]

    if view.ViewType in invalid_view_types:
        OUT = [], [], [], ["Active view tidak mendukung tagging door. Gunakan Floor Plan / Ceiling Plan / Section / Elevation."]
    else:
        tagType = FilteredElementCollector(doc) \
            .OfClass(FamilySymbol) \
            .OfCategory(BuiltInCategory.OST_DoorTags) \
            .FirstElement()

        if tagType is None:
            OUT = [], [], [], ["Tidak ditemukan Door Tag di project. Load Door Tag family dulu."]
        else:
            # semua door yang terlihat pada active view
            doors = list(
                FilteredElementCollector(doc, view.Id)
                .OfCategory(BuiltInCategory.OST_Doors)
                .WhereElementIsNotElementType()
                .ToElements()
            )

            existing_tagged_ids = get_existing_tagged_door_ids(doc, view)

            created = []
            skipped = []
            errors = []

            TransactionManager.Instance.EnsureInTransaction(doc)

            try:
                if not tagType.IsActive:
                    tagType.Activate()
                    doc.Regenerate()

                for door in doors:
                    try:
                        if door is None:
                            continue

                        did = door.Id.IntegerValue

                        # kalau sudah ada tag, skip
                        if did in existing_tagged_ids:
                            skipped.append(did)
                            continue

                        pt = get_door_center(door, view)
                        if pt is None:
                            errors.append("Door ID {} tidak punya titik yang valid.".format(did))
                            continue

                        tag = IndependentTag.Create(
                            doc,
                            view.Id,
                            Reference(door),
                            False,  # no leader
                            TagMode.TM_ADDBY_CATEGORY,
                            TagOrientation.Horizontal,
                            pt
                        )

                        tag.HasLeader = False
                        created.append(did)

                    except Exception as e:
                        try:
                            did = door.Id.IntegerValue
                        except:
                            did = "Unknown"
                        errors.append("Door ID {} gagal: {}".format(did, str(e)))

            finally:
                TransactionManager.Instance.TransactionTaskDone()

            OUT = created, skipped, list(existing_tagged_ids), errors
# ----------------------------------------
watch = Watch(python_script)
