# Dynamo graph auto-tag-floors.dyn (Dynamo 3.3.0.6316)

boolean = BoolSelector(true)  # graph input
python_script = Python(IN[0]=boolean)  # CPython3; graph output
# ---------- python_script.python (157 lines) ----------
# IN[0] = run trigger (boolean)

import clr

clr.AddReference('RevitAPI')
from Autodesk.Revit.DB import *

clr.AddReference('RevitServices')
from RevitServices.Persistence import DocumentManager
from RevitServices.Transactions import TransactionManager

doc = DocumentManager.Instance.CurrentDBDocument
view = doc.ActiveView
runIt = IN[0]

def get_floor_center(floor, view):
    bbox = floor.get_BoundingBox(view)
    if bbox:
        return XYZ(
            (bbox.Min.X + bbox.Max.X) / 2.0,
            (bbox.Min.Y + bbox.Max.Y) / 2.0,
            (bbox.Min.Z + bbox.Max.Z) / 2.0
        )
    return None

def get_existing_tagged_floor_ids(doc, view):
    tagged_ids = set()

    tags = FilteredElementCollector(doc, view.Id) \
        .OfClass(IndependentTag) \
        .ToElements()

    for tag in tags:
        try:
            if tag.Category is None:
                continue
            if tag.Category.Id.IntegerValue != int(BuiltInCategory.OST_FloorTags):
                continue

            try:
                ids = tag.GetTaggedLocalElementIds()
                if ids:
                    for eid in ids:
                        tagged_ids.add(eid.IntegerValue)
                    continue
            except:
                pass

            try:
                eid = tag.TaggedLocalElementId
                if eid and eid.IntegerValue > 0:
                    tagged_ids.add(eid.IntegerValue)
                    continue
            except:
                pass

            try:
                ref = tag.GetTaggedReference()
                if ref and ref.ElementId.IntegerValue > 0:
                    tagged_ids.add(ref.ElementId.IntegerValue)
                    continue
            except:
                pass

        except:
            pass

    return tagged_ids

if not runIt:
    OUT = "Set Boolean ke True untuk menjalankan script.", [], [], []
else:
    invalid_view_types = [
        ViewType.ThreeD,
        ViewType.Schedule,
        ViewType.DrawingSheet,
        ViewType.ProjectBrowser,
        ViewType.SystemBrowser,
        ViewType.Report,
        ViewType.CostReport,
        ViewType.LoadsReport,
        ViewType.PresureLossReport,
        ViewType.ColumnSchedule,
        ViewType.PanelSchedule
    ]

    if view.ViewType in invalid_view_types:
        OUT = [], [], [], ["Active view tidak mendukung tagging floor. Gunakan Floor Plan / Section / Elevation."]
    else:
        tagType = FilteredElementCollector(doc) \
            .OfClass(FamilySymbol) \
            .OfCategory(BuiltInCategory.OST_FloorTags) \
            .FirstElement()

        if tagType is None:
            OUT = [], [], [], ["Tidak ditemukan Floor Tag di project. Load Floor Tag family dulu."]
        else:
            floors = list(
                FilteredElementCollector(doc, view.Id)
                .OfCategory(BuiltInCategory.OST_Floors)
                .WhereElementIsNotElementType()
                .ToElements()
            )

            existing_tagged_ids = get_existing_tagged_floor_ids(doc, view)

            created = []
            skipped = []
            errors = []

            TransactionManager.Instance.EnsureInTransaction(doc)

            try:
                if not tagType.IsActive:
                    tagType.Activate()
                    doc.Regenerate()

                for floor in floors:
                    try:
                        if floor is None:
                            continue

                        fid = floor.Id.IntegerValue

                        if fid in existing_tagged_ids:
                            skipped.append(fid)
                            continue

                        pt = get_floor_center(floor, view)
                        if pt is None:
                            errors.append("Floor ID {} tidak punya titik yang valid.".format(fid))
                            continue

                        tag = IndependentTag.Create(
                            doc,
                            view.Id,
                            Reference(floor),
                            False,
                            TagMode.TM_ADDBY_CATEGORY,
                            TagOrientation.Horizontal,
                            pt
                        )

                        tag.HasLeader = False
                        created.append(fid)

                    except Exception as e:
                        try:
                            fid = floor.Id.IntegerValue
                        except:
                            fid = "Unknown"
                        errors.append("Floor ID {} gagal: {}".format(fid, str(e)))

            finally:
                TransactionManager.Instance.TransactionTaskDone()

            OUT = created, skipped, list(existing_tagged_ids), errors
# ----------------------------------------
