# Dynamo graph auto-tag-windows.dyn (Dynamo 3.3.0.6316)

boolean = BoolSelector(true)  # graph input
python_script = Python(IN[0]=boolean)  # CPython3; graph output
# ---------- python_script.python (165 lines) ----------
# IN[0] = run trigger (boolean)

import clr

clr.AddReference('RevitAPI')
from Autodesk.Revit.DB import *

clr.AddReference('RevitServices')
from RevitServices.Persistence import DocumentManager
from RevitServices.Transactions import TransactionManager

doc = DocumentManager.Instance.CurrentDBDocument
view = doc.ActiveView
runIt = IN[0]

def get_window_center(window, view):
    bbox = window.get_BoundingBox(view)
    if bbox:
        return XYZ(
            (bbox.Min.X + bbox.Max.X) / 2.0,
            (bbox.Min.Y + bbox.Max.Y) / 2.0,
            (bbox.Min.Z + bbox.Max.Z) / 2.0
        )

    loc = window.Location
    if isinstance(loc, LocationPoint):
        return loc.Point

    if isinstance(loc, LocationCurve):
        return loc.Curve.Evaluate(0.5, True)

    return None

def get_existing_tagged_window_ids(doc, view):
    tagged_ids = set()

    tags = FilteredElementCollector(doc, view.Id) \
        .OfClass(IndependentTag) \
        .ToElements()

    for tag in tags:
        try:
            if tag.Category is None:
                continue
            if tag.Category.Id.IntegerValue != int(BuiltInCategory.OST_WindowTags):
                continue

            try:
                ids = tag.GetTaggedLocalElementIds()
                if ids:
                    for eid in ids:
                        tagged_ids.add(eid.IntegerValue)
                    continue
            except:
                pass

            try:
                eid = tag.TaggedLocalElementId
                if eid and eid.IntegerValue > 0:
                    tagged_ids.add(eid.IntegerValue)
                    continue
            except:
                pass

            try:
                ref = tag.GetTaggedReference()
                if ref and ref.ElementId.IntegerValue > 0:
                    tagged_ids.add(ref.ElementId.IntegerValue)
                    continue
            except:
                pass

        except:
            pass

    return tagged_ids

if not runIt:
    OUT = "Set Boolean ke True untuk menjalankan script.", [], [], []
else:
    invalid_view_types = [
        ViewType.ThreeD,
        ViewType.Schedule,
        ViewType.DrawingSheet,
        ViewType.ProjectBrowser,
        ViewType.SystemBrowser,
        ViewType.Report,
        ViewType.CostReport,
        ViewType.LoadsReport,
        ViewType.PresureLossReport,
        ViewType.ColumnSchedule,
        ViewType.PanelSchedule
    ]

    if view.ViewType in invalid_view_types:
        OUT = [], [], [], ["Active view tidak mendukung tagging window. Gunakan Floor Plan / Ceiling Plan / Section / Elevation."]
    else:
        tagType = FilteredElementCollector(doc) \
            .OfClass(FamilySymbol) \
            .OfCategory(BuiltInCategory.OST_WindowTags) \
            .FirstElement()

        if tagType is None:
            OUT = [], [], [], ["Tidak ditemukan Window Tag di project. Load Window Tag family dulu."]
        else:
            windows = list(
                FilteredElementCollector(doc, view.Id)
                .OfCategory(BuiltInCategory.OST_Windows)
                .WhereElementIsNotElementType()
                .ToElements()
            )

            existing_tagged_ids = get_existing_tagged_window_ids(doc, view)

            created = []
            skipped = []
            errors = []

            TransactionManager.Instance.EnsureInTransaction(doc)

            try:
                if not tagType.IsActive:
                    tagType.Activate()
                    doc.Regenerate()

                for window in windows:
                    try:
                        if window is None:
                            continue

                        wid = window.Id.IntegerValue

                        if wid in existing_tagged_ids:
                            skipped.append(wid)
                            continue

                        pt = get_window_center(window, view)
                        if pt is None:
                            errors.append("Window ID {} tidak punya titik yang valid.".format(wid))
                            continue

                        tag = IndependentTag.Create(
                            doc,
                            view.Id,
                            Reference(window),
                            False,
                            TagMode.TM_ADDBY_CATEGORY,
                            TagOrientation.Horizontal,
                            pt
                        )

                        tag.HasLeader = False
                        created.append(wid)

                    except Exception as e:
                        try:
                            wid = window.Id.IntegerValue
                        except:
                            wid = "Unknown"
                        errors.append("Window ID {} gagal: {}".format(wid, str(e)))

            finally:
                TransactionManager.Instance.TransactionTaskDone()

            OUT = created, skipped, list(existing_tagged_ids), errors
# ----------------------------------------
