# Dynamo graph merge-two-floors.dyn (Dynamo 3.3.0.6316)

floor_1 = DSModelElementSelection()  # 1 picked in the model; graph input
floor_2 = DSModelElementSelection()  # 1 picked in the model; graph input
delete_old_floors = BoolSelector(true)  # graph input
python_script = Python(IN[0]=floor_1, IN[1]=floor_2, IN[2]=delete_old_floors)  # CPython3
# ---------- python_script.python (212 lines) ----------
import clr

clr.AddReference('RevitAPI')
clr.AddReference('RevitServices')
clr.AddReference('System')

from Autodesk.Revit.DB import *
from RevitServices.Persistence import DocumentManager
from RevitServices.Transactions import TransactionManager
from System.Collections.Generic import List

doc = DocumentManager.Instance.CurrentDBDocument

def unwrap(x):
    try:
        return UnwrapElement(x)
    except:
        return x

floor1 = unwrap(IN[0])
floor2 = unwrap(IN[1])
delete_old = IN[2] if IN[2] is not None else False

tol_z = 1e-6

def get_first_solid(elem):
    opt = Options()
    opt.ComputeReferences = True
    opt.IncludeNonVisibleObjects = True
    geo = elem.get_Geometry(opt)
    if geo is None:
        return None

    solids = []

    def collect_solids(geom):
        for g in geom:
            if isinstance(g, Solid) and g.Volume > 1e-9:
                solids.append(g)
            elif isinstance(g, GeometryInstance):
                inst_geo = g.GetInstanceGeometry()
                collect_solids(inst_geo)

    collect_solids(geo)

    if not solids:
        return None

    # ambil solid dengan volume terbesar
    solids.sort(key=lambda s: s.Volume, reverse=True)
    return solids[0]

def get_top_planar_face(solid):
    top_face = None
    top_z = -1e100

    for f in solid.Faces:
        pf = f if isinstance(f, PlanarFace) else None
        if pf is None:
            continue

        n = pf.FaceNormal.Normalize()

        # hanya ambil face yang menghadap ke atas
        if n.Z <= 0.999:
            continue

        # ambil face tertinggi berdasarkan titik origin
        z = pf.Origin.Z
        if z > top_z:
            top_z = z
            top_face = pf

    return top_face

def curve_loop_avg_z(loop):
    zs = []
    for c in loop:
        zs.append(c.GetEndPoint(0).Z)
        zs.append(c.GetEndPoint(1).Z)
    if not zs:
        return None
    return sum(zs) / float(len(zs))

def clone_loop(loop):
    new_loop = CurveLoop()
    for c in loop:
        new_loop.Append(c.Clone())
    return new_loop

def sort_loops_outer_first(loops):
    # loop terpanjang biasanya outer boundary
    temp = []
    for lp in loops:
        try:
            length = lp.GetExactLength()
        except:
            length = 0.0
        temp.append((length, lp))

    temp.sort(key=lambda x: x[0], reverse=True)
    return [x[1] for x in temp]

def orient_loops_for_floor(loops):
    # asumsi normal +Z
    # outer = CCW, inner holes = CW
    if not loops:
        return loops

    loops_sorted = sort_loops_outer_first(loops)
    result = []

    for i, lp in enumerate(loops_sorted):
        cl = clone_loop(lp)
        is_ccw = cl.IsCounterclockwise(XYZ.BasisZ)

        if i == 0:
            # outer loop harus CCW
            if not is_ccw:
                cl.Flip()
        else:
            # inner loops / holes harus CW
            if is_ccw:
                cl.Flip()

        result.append(cl)

    return result

# validasi awal
if floor1 is None or floor2 is None:
    OUT = "Pilih 2 floor."
elif not isinstance(floor1, Floor) or not isinstance(floor2, Floor):
    OUT = "Input harus 2 elemen Floor."
elif floor1.Id == floor2.Id:
    OUT = "Floor 1 dan Floor 2 tidak boleh sama."
elif floor1.LevelId != floor2.LevelId:
    OUT = "Kedua floor harus di level yang sama."
else:
    solid1 = get_first_solid(floor1)
    solid2 = get_first_solid(floor2)

    if solid1 is None or solid2 is None:
        OUT = "Gagal membaca solid floor."
    else:
        try:
            union_solid = BooleanOperationsUtils.ExecuteBooleanOperation(
                solid1,
                solid2,
                BooleanOperationsType.Union
            )
        except Exception as e:
            OUT = "Boolean union gagal: {}".format(str(e))
        else:
            top_face = get_top_planar_face(union_solid)

            if top_face is None:
                OUT = "Tidak menemukan top planar face dari hasil union."
            else:
                raw_loops = list(top_face.GetEdgesAsCurveLoops())

                # filter hanya loop pada elevasi top face
                top_z = top_face.Origin.Z
                filtered = []

                for lp in raw_loops:
                    avgz = curve_loop_avg_z(lp)
                    if avgz is not None and abs(avgz - top_z) < 1e-4:
                        filtered.append(lp)

                if not filtered:
                    filtered = raw_loops

                profile_loops = orient_loops_for_floor(filtered)

                # validasi boundary
                is_valid = BoundaryValidation.IsValidHorizontalBoundary(profile_loops)

                if not is_valid:
                    OUT = "Boundary hasil union tidak valid untuk Floor.Create."
                else:
                    floor_type_id = floor1.FloorType.Id
                    level_id = floor1.LevelId

                    TransactionManager.Instance.EnsureInTransaction(doc)

                    try:
                        profile = List[CurveLoop]()
                        for lp in profile_loops:
                            profile.Add(lp)

                        new_floor = Floor.Create(doc, profile, floor_type_id, level_id)

                        # samakan offset dari floor1 kalau ada
                        try:
                            p1 = floor1.get_Parameter(BuiltInParameter.FLOOR_HEIGHTABOVELEVEL_PARAM)
                            p2 = new_floor.get_Parameter(BuiltInParameter.FLOOR_HEIGHTABOVELEVEL_PARAM)
                            if p1 and p2 and (not p1.IsReadOnly) and (not p2.IsReadOnly):
                                p2.Set(p1.AsDouble())
                        except:
                            pass

                        if delete_old:
                            doc.Delete(floor1.Id)
                            doc.Delete(floor2.Id)

                        OUT = new_floor

                    except Exception as e:
                        OUT = "Floor.Create gagal: {}".format(str(e))

                    TransactionManager.Instance.TransactionTaskDone()
# ----------------------------------------
