# Dynamo graph qc-room-department.dyn (Dynamo 3.3.0.6316)

categories = Categories("OST_Rooms")
all_elements_of_category = ElementsOfCategory(Category=categories)
code_block = CodeBlock { "Name"; "Department"; "Level"; }
getParameterValueByName = Element.GetParameterValueByName(element=all_elements_of_category, parameterName=code_block.out2)
getParameterValueByName_2 = Element.GetParameterValueByName(element=all_elements_of_category, parameterName=code_block.out1)
code_block_2 = CodeBlock { ""; }
eq = getParameterValueByName_2 == code_block_2
filterByBoolMask = List.FilterByBoolMask(list=getParameterValueByName, mask=eq)
getParameterValueByName_3 = Element.GetParameterValueByName(element=all_elements_of_category, parameterName=code_block.out0)
filterByBoolMask_2 = List.FilterByBoolMask(list=getParameterValueByName_3, mask=eq)
code_block_3 = CodeBlock(level=filterByBoolMask.in, name=filterByBoolMask_2.in) { level + "|" + name; }
watch = Watch(code_block_3)
