# Dynamo graph spbe-shared-parameters.dyn "inject-shared-parameters" (Dynamo 3.3.0.6316)

sharedParameterFile = Parameter.SharedParameterFile()
code_block = CodeBlock { "SPBE"; }
string = StringInput("SPBE - Kode RAB")
code_block_2 = CodeBlock { "Type"; }
python_script = Python(IN[0]=sharedParameterFile, IN[1]=code_block, IN[2]=string, IN[3]=code_block_2)  # CPython3
# ---------- python_script.python (131 lines) ----------
# Dynamo Python Script
# IN[0] = shared parameter file path, contoh: r"C:\BIM\Company_SharedParameters.txt"
# IN[1] = group name di file shared parameter, contoh: "Data Perencanaan"
# IN[2] = parameter name, contoh: "SP_ReferensiStandar"
# IN[3] = binding mode, isi "Type" atau "Instance"

import clr

clr.AddReference("RevitAPI")
from Autodesk.Revit.DB import *

clr.AddReference("RevitServices")
from RevitServices.Persistence import DocumentManager
from RevitServices.Transactions import TransactionManager

doc = DocumentManager.Instance.CurrentDBDocument
uiapp = DocumentManager.Instance.CurrentUIApplication
app = uiapp.Application

sp_file_path = IN[0]
group_name = IN[1]
param_name = IN[2]
binding_mode = IN[3]

result = {
    "success": False,
    "message": "",
    "bound_categories": [],
    "skipped_categories": []
}

def get_external_definition(def_file, group_name, param_name):
    if def_file is None:
        return None, "Shared parameter file tidak bisa dibuka."
    
    target_group = None
    for g in def_file.Groups:
        if g.Name == group_name:
            target_group = g
            break
    
    if target_group is None:
        return None, "Group '{}' tidak ditemukan.".format(group_name)
    
    target_def = None
    for d in target_group.Definitions:
        if d.Name == param_name:
            target_def = d
            break
    
    if target_def is None:
        return None, "Parameter '{}' tidak ditemukan dalam group '{}'.".format(param_name, group_name)
    
    return target_def, None

try:
    # Set shared parameter file aktif
    app.SharedParametersFilename = sp_file_path
    def_file = app.OpenSharedParameterFile()

    ext_def, err = get_external_definition(def_file, group_name, param_name)
    if err:
        result["message"] = err
        OUT = result
    else:
        cat_set = app.Create.NewCategorySet()

        # Ambil semua kategori yang boleh diberi project/shared parameter
        for cat in doc.Settings.Categories:
            try:
                # Filter kategori yang valid untuk bound parameter
                if cat and cat.AllowsBoundParameters:
                    # Optional: skip tag categories, analytical, internal, dsb bila mau
                    # if not cat.IsTagCategory:
                    cat_set.Insert(cat)
                    result["bound_categories"].append(cat.Name)
                else:
                    if cat:
                        result["skipped_categories"].append(cat.Name)
            except:
                # Ada beberapa kategori yang kadang error saat dibaca
                try:
                    result["skipped_categories"].append(cat.Name)
                except:
                    pass

        if cat_set.IsEmpty:
            result["message"] = "Tidak ada kategori yang valid untuk di-bind."
            OUT = result
        else:
            if str(binding_mode).lower() == "type":
                binding = app.Create.NewTypeBinding(cat_set)
            else:
                binding = app.Create.NewInstanceBinding(cat_set)

            binding_map = doc.ParameterBindings

            TransactionManager.Instance.EnsureInTransaction(doc)

            # Pilih group tampilan di Properties
            # Untuk Revit baru, GroupTypeId.Text umumnya aman
            ok = False
            try:
                ok = binding_map.Insert(ext_def, binding, GroupTypeId.Text)
            except:
                # fallback untuk API lama
                ok = binding_map.Insert(ext_def, binding, BuiltInParameterGroup.PG_TEXT)

            if not ok:
                try:
                    ok = binding_map.ReInsert(ext_def, binding, GroupTypeId.Text)
                except:
                    ok = binding_map.ReInsert(ext_def, binding, BuiltInParameterGroup.PG_TEXT)

            TransactionManager.Instance.TransactionTaskDone()

            result["success"] = bool(ok)
            if ok:
                result["message"] = "Parameter berhasil di-bind ke {} kategori.".format(len(result["bound_categories"]))
            else:
                result["message"] = "Binding gagal. Cek apakah parameter sudah ada dengan mode binding berbeda."

            OUT = result

except Exception as e:
    try:
        TransactionManager.Instance.ForceCloseTransaction()
    except:
        pass
    result["message"] = str(e)
    OUT = result
# ----------------------------------------
sharedParameterFile_2 = Parameter.SharedParameterFile()
code_block_3 = CodeBlock { "SPBE"; }
string_2 = StringInput("SPBE - Referensi Standar")
code_block_4 = CodeBlock { "Type"; }
python_script_2 = Python(IN[0]=sharedParameterFile_2, IN[1]=code_block_3, IN[2]=string_2, IN[3]=code_block_4)  # CPython3; same code as python_script
