# Dynamo graph str-column-split-by-levels.dyn "str-columns-split-by-level" (Dynamo 3.3.0.6316)

boolean = BoolSelector(true)
python_script = Python(IN[0]=boolean)  # CPython3
# ---------- python_script.python (204 lines) ----------
# Dynamo Python (CPython3) - Split Multi-Story Structural Columns into per-Level segments
# IN[0] : DeleteOriginal (bool)
# IN[1] : SkipIfAlreadySplit (bool) - if True, skip columns whose Comments contains TagString
# IN[2] : TagString (string) - marker written to new columns' Comments

import clr

clr.AddReference("RevitServices")
from RevitServices.Persistence import DocumentManager
from RevitServices.Transactions import TransactionManager

clr.AddReference("RevitAPI")
from Autodesk.Revit.DB import (
    FilteredElementCollector, BuiltInCategory, BuiltInParameter,
    ElementId, XYZ, Level, FamilyInstance, Line, ElementTransformUtils
)
from Autodesk.Revit.DB.Structure import StructuralType

doc = DocumentManager.Instance.CurrentDBDocument

# Inputs
delete_original = bool(IN[0]) if len(IN) > 0 and IN[0] is not None else False
skip_if_tagged  = bool(IN[1]) if len(IN) > 1 and IN[1] is not None else True
tag_string      = str(IN[2]) if len(IN) > 2 and IN[2] is not None else "SPLIT_BY_DYNAMO"

TOL = 1e-6  # feet tolerance

def get_param_double(e, bip, default=0.0):
    p = e.get_Parameter(bip)
    return p.AsDouble() if p else default

def get_param_eid(e, bip):
    p = e.get_Parameter(bip)
    return p.AsElementId() if p else ElementId.InvalidElementId

def set_param_double(e, bip, val):
    p = e.get_Parameter(bip)
    if p and (not p.IsReadOnly):
        p.Set(val)

def set_param_eid(e, bip, eid):
    p = e.get_Parameter(bip)
    if p and (not p.IsReadOnly):
        p.Set(eid)

def get_comments(e):
    p = e.get_Parameter(BuiltInParameter.ALL_MODEL_INSTANCE_COMMENTS)
    return p.AsString() if p else None

def set_comments(e, s):
    p = e.get_Parameter(BuiltInParameter.ALL_MODEL_INSTANCE_COMMENTS)
    if p and (not p.IsReadOnly):
        p.Set(s)

def normalize_angle(a):
    import math
    twopi = 2.0 * math.pi
    while a < 0: a += twopi
    while a >= twopi: a -= twopi
    return a

# Collect and sort Levels by elevation
levels = list(FilteredElementCollector(doc).OfClass(Level).ToElements())
levels_sorted = sorted(levels, key=lambda l: l.Elevation)
level_index = {lv.Id.IntegerValue: i for i, lv in enumerate(levels_sorted)}
level_elev  = {lv.Id.IntegerValue: lv.Elevation for lv in levels_sorted}

# Collect structural columns (instances)
cols = list(
    FilteredElementCollector(doc)
    .OfCategory(BuiltInCategory.OST_StructuralColumns)
    .WhereElementIsNotElementType()
    .ToElements()
)

created_ids = []
processed_split = 0
skipped = []

TransactionManager.Instance.EnsureInTransaction(doc)

for c in cols:
    try:
        if not isinstance(c, FamilyInstance):
            skipped.append((c.Id.IntegerValue, "Not a FamilyInstance"))
            continue

        # Anti-dup: skip if already tagged
        if skip_if_tagged:
            comm = get_comments(c) or ""
            if tag_string and (tag_string in comm):
                skipped.append((c.Id.IntegerValue, "Already tagged (skipped)"))
                continue

        # Only vertical columns with LocationPoint
        loc = c.Location
        pt = getattr(loc, "Point", None)
        if pt is None:
            skipped.append((c.Id.IntegerValue, "No LocationPoint (slanted/curve?)"))
            continue

        symbol = c.Symbol
        if symbol is None:
            skipped.append((c.Id.IntegerValue, "No Symbol"))
            continue

        base_lvl_id = get_param_eid(c, BuiltInParameter.FAMILY_BASE_LEVEL_PARAM)
        top_lvl_id  = get_param_eid(c, BuiltInParameter.FAMILY_TOP_LEVEL_PARAM)

        if base_lvl_id == ElementId.InvalidElementId or top_lvl_id == ElementId.InvalidElementId:
            skipped.append((c.Id.IntegerValue, "Missing base/top level"))
            continue

        base_i = level_index.get(base_lvl_id.IntegerValue, None)
        top_i  = level_index.get(top_lvl_id.IntegerValue, None)
        if base_i is None or top_i is None:
            skipped.append((c.Id.IntegerValue, "Base/Top not found in level list"))
            continue

        # If adjacent (or same) levels: nothing to split
        if top_i <= base_i + 1:
            continue

        base_off = get_param_double(c, BuiltInParameter.FAMILY_BASE_LEVEL_OFFSET_PARAM, 0.0)
        top_off  = get_param_double(c, BuiltInParameter.FAMILY_TOP_LEVEL_OFFSET_PARAM, 0.0)

        # Absolute base/top elevations (used only to preserve offsets correctly)
        z_base = level_elev[base_lvl_id.IntegerValue] + base_off
        z_top  = level_elev[top_lvl_id.IntegerValue]  + top_off
        if z_top <= z_base + TOL:
            skipped.append((c.Id.IntegerValue, "Non-positive height"))
            continue

        base_level = doc.GetElement(base_lvl_id)
        top_level  = doc.GetElement(top_lvl_id)

        between_levels = levels_sorted[base_i + 1 : top_i]  # ALL levels between base and top by index
        split_levels = [base_level] + between_levels + [top_level]

        # Keep rotation
        rot = 0.0
        try:
            rot = normalize_angle(loc.Rotation)
        except:
            rot = 0.0

        # Create per-level segments
        for i in range(len(split_levels) - 1):
            lv_b = split_levels[i]
            lv_t = split_levels[i + 1]

            # preserve original absolute offsets only at ends
            seg_base_off = (z_base - lv_b.Elevation) if i == 0 else 0.0
            seg_top_off  = (z_top  - lv_t.Elevation) if i == (len(split_levels) - 2) else 0.0

            new_col = doc.Create.NewFamilyInstance(pt, symbol, lv_b, StructuralType.Column)

            # rotate around vertical axis through point
            if abs(rot) > 1e-9:
                axis = Line.CreateUnbound(pt, XYZ.BasisZ)
                ElementTransformUtils.RotateElement(doc, new_col.Id, axis, rot)

            # set constraints
            set_param_eid(new_col, BuiltInParameter.FAMILY_BASE_LEVEL_PARAM, lv_b.Id)
            set_param_double(new_col, BuiltInParameter.FAMILY_BASE_LEVEL_OFFSET_PARAM, seg_base_off)

            set_param_eid(new_col, BuiltInParameter.FAMILY_TOP_LEVEL_PARAM, lv_t.Id)
            set_param_double(new_col, BuiltInParameter.FAMILY_TOP_LEVEL_OFFSET_PARAM, seg_top_off)

            # tag to prevent duplicate creation on rerun
            if tag_string:
                prev = get_comments(new_col) or ""
                new_val = (prev + " | " + tag_string).strip(" |") if prev else tag_string
                set_comments(new_col, new_val)

            created_ids.append(new_col.Id.IntegerValue)

        processed_split += 1

        # delete original after successful creation
        if delete_original:
            doc.Delete(c.Id)
        else:
            # if not deleting, tag original too (so rerun won't duplicate)
            if tag_string:
                prev = get_comments(c) or ""
                new_val = (prev + " | " + tag_string).strip(" |") if prev else tag_string
                set_comments(c, new_val)

    except Exception as ex:
        skipped.append((c.Id.IntegerValue, "Exception: {}".format(ex)))

TransactionManager.Instance.TransactionTaskDone()

OUT = {
    "delete_original": delete_original,
    "skip_if_tagged": skip_if_tagged,
    "tag_string": tag_string,
    "processed_columns_split": processed_split,
    "new_columns_created": len(created_ids),
    "created_element_ids": created_ids[:200],  # limit output size
    "skipped_count": len(skipped),
    "skipped_sample": skipped[:50]
}
# ----------------------------------------
